# Grasshopper definition 2.26_BarcelonaAnimatingWater_v002Pool.gh (Grasshopper 1.0.7)
# plug-ins: Human, Fologram For Grasshopper Utilities, Bifocals, FologramForGrasshopper

sync_parameters = SyncParameters(
    augmented_trigger_0_key=animate_texture,
    augmented_trigger_1_key=button,
    augmented_trigger_2_key=animation_speed,
    augmented_trigger_3_key=water_texture_scale,
    augmented_trigger_4_key=number_slider,
    componentVersion=1,
    num_augmented_triggers=5)
animate_texture = BooleanToggle(True)
state_gate = StateGate(States=animate_texture)
timer = Timer(TimerInterval=20, Target=counter)
animation_speed = Slider(0.796, range=0..1)
button = Button()
counter = Counter(Reset=button)
multiplication = Multiplication(A=counter, B=animation_speed)
number_slider = Slider(38, range=0..100)
vector_xyz = VectorXYZ(XComponent=multiplication, YComponent=0, ZComponent=0)  # -> Vector, Length
water_texture_scale = Slider(100, range=0..100)
mesh_plane = MeshPlane(
    Boundary=[{Plane=PlaneXY(-220, -99, -3.5), Size=Domain2(u=-220..220, v=-99..99)}, {Plane=PlaneXY(616, 11, -3.5), Size=Domain2(u=-44..44, v=-121..121)}],
    WidthCount=1,
    HeightCount=1)  # -> Mesh, Area
geo = Geometry(<mesh referenced from the Rhino model>)
xy_plane = XYPlane(Origin=vector_xyz.Vector)
msphere = MeshSphere(Base=PlaneXY(0, 0, 0), Radius=number_slider, UCount=10, VCount=20)
planarmapping = PlanarMapping(Mesh=mesh_plane.Mesh, Plane=xy_plane, XExtents=water_texture_scale, YExtents=water_texture_scale)  # -> MappedMesh, MappingPlane
sync_object = SyncObject(
    GM=planarmapping.MappedMesh,
    AlwaysIncludeTextureCoordinates=False,
    Clickable=False,
    DefaultCurveThicknessMillimeters=2.5,
    DefaultGlossPercent=0,
    DefaultMaterialColor=RGB(255, 255, 255),
    DefaultSpecularPercent=0,
    Interactive=False,
    TextureFileName="G:\Shared drives\Development\QA\FologramNEXT January 2020\Sean QA\Community Posts - Grasshopper\Water.jpg",
    hasSerializedData=True)
